# Dynamo graph dynamicSectionView.dyn (Dynamo 1.2.1.3083)

# note: para1: image export directory
# para2: scale: digit vs. print (feet)
# para3: ppi
# para4: ScopeBox name
# para5: ViewTemplate name
# para6: delete temporary DetailView afterward
code_block = CodeBlock { "C:\Dynamo\\test\ViewRange\\test_views\\slice"; 64; 400; "3D Print"; "3d Print"; false; }
dynamicsectionview_python_script = Python(IN[0]=code_block.out0, IN[1]=code_block.out1, IN[2]=code_block.out2, IN[3]=code_block.out3, IN[4]=code_block.out4, IN[5]=code_block.out5)
# ---------- dynamicsectionview_python_script.python (171 lines) ----------
import clr
clr.AddReference('ProtoGeometry')
from Autodesk.DesignScript.Geometry import *

# Import Element wrapper extension methods
clr.AddReference('RevitNodes')
import Revit
clr.ImportExtensions(Revit.Elements)

# Import geometry conversion extension methods
clr.ImportExtensions(Revit.GeometryConversion)

# Import DocumentManager and TransactionManager
clr.AddReference('RevitServices')
import RevitServices
from RevitServices.Persistence import DocumentManager
from RevitServices.Transactions import TransactionManager

# Import RevitAPI
clr.AddReference('RevitAPI')
import Autodesk
from Autodesk.Revit.DB import *
from Autodesk.Revit.DB import FilteredElementCollector as _FilteredElementCollector
from Autodesk.Revit.DB import ViewFamilyType as _ViewFamilyType

import System
from System import Array
from System.Collections.Generic import *
import sys

import math


def get_ViewFamilyTypeId(viewFamilyTypeName):	
	names = []
	ids = []
	viewFamilyTypeId = -1
	collector = _FilteredElementCollector(doc).OfClass(_ViewFamilyType) #collecting all elements of type ViewFamilyType
	for t in collector:
		names.append(t.FamilyName)
		ids.append(t.Id)
		if t.FamilyName == viewFamilyTypeName:
			viewFamilyTypeId = t.Id
			break # get the first
	return viewFamilyTypeId
			
			
def create_view(doc, viewFamilyTypeId, boundingBox, voxel_size):		
	if viewFamilyTypeId != -1:
		TransactionManager.Instance.EnsureInTransaction(doc)
		
		boundingBoxSlice = boundingBox
		boundingBoxSlice.Max = XYZ(boundingBox.Max.X, boundingBox.Max.Y, boundingBox.Min.Z + voxel_size)  # adjust boundingbox for far clip offset		
		sectionView = ViewSection.CreateDetail(doc, viewFamilyTypeId, boundingBoxSlice) 					
		
		viewId = Autodesk.Revit.DB.ElementId(int(str(sectionView.Id)) - 1)
		minY = boundingBoxSlice.Min.Y
		maxY = boundingBoxSlice.Max.Y
		midY = (maxY + minY) / 2
		minX = boundingBoxSlice.Min.X
		maxX = boundingBoxSlice.Max.X
		axis = Line.CreateBound(XYZ(minX, midY, 0), XYZ(maxX, midY, 0))  # flip DetailView direction
		ElementTransformUtils.RotateElement(doc, viewId, axis, math.pi)	
		
		TransactionManager.Instance.TransactionTaskDone()
		return sectionView


def update_view(doc, view, voxel_size):
	TransactionManager.Instance.EnsureInTransaction(doc)	
	translationVec = XYZ(0, 0, voxel_size)
	viewId = Autodesk.Revit.DB.ElementId(int(str(view.Id)) - 1)
	ElementTransformUtils.MoveElement(doc, viewId, translationVec)	
	TransactionManager.Instance.TransactionTaskDone()
	return sectionView, height
	
	
def export_view_image(view, path, image_width, doc):
	TransactionManager.Instance.EnsureInTransaction(doc)
	ieo = ImageExportOptions()
	ieo.ExportRange = ExportRange.SetOfViews
	ieo.SetViewsAndSheets([view.Id])
	ieo.FilePath = path	
	ieo.HLRandWFViewsFileType = ImageFileType.PNG
	ieo.ShadowViewsFileType = ImageFileType.PNG
	ieo.PixelSize = image_width
	doc.ExportImage(ieo)
	TransactionManager.Instance.TransactionTaskDone()
	
	
def delete_views(doc, views):
	TransactionManager.Instance.EnsureInTransaction(doc)	
	for view in views:
		doc.Delete(view.Id)
	TransactionManager.Instance.TransactionTaskDone()


def apply_viewTemplate(doc, view, viewTemplateName):
	viewTemplate = None
	collector = FilteredElementCollector(doc).OfClass(View)
	for i in collector:
		if i.IsTemplate == True and i.Name == viewTemplateName:
			viewTemplate = i
	
	TransactionManager.Instance.EnsureInTransaction(doc)
	if viewTemplate is not None:
		view.ViewTemplateId = viewTemplate.Id
	TransactionManager.Instance.TransactionTaskDone()


def get_scopeBox(name):
	collector = FilteredElementCollector(doc)
	elements = collector.OfCategory(BuiltInCategory.OST_VolumeOfInterest).ToElements()
	for element in elements:
		if element.Name == name:
			return element


filePath = IN[0]
scale = IN[1]
ppi = IN[2]
scopeBox_name = IN[3]
viewTemplateName = IN[4]
is_delete = IN[5]

doc = DocumentManager.Instance.CurrentDBDocument
scopeBox = get_scopeBox(scopeBox_name)

try:
	count = -1
	heights = []
	
	viewFamilyTypeId = get_ViewFamilyTypeId("Detail View")
	boundingBox = scopeBox.get_BoundingBox(None) # https://github.com/DynamoDS/DynamoRevit/blob/Revit2015/src/Libraries/RevitNodes/Elements/Element.cs
	
	voxel_size = scale * 12.0 / ppi
	image_width = (boundingBox.Max.X - boundingBox.Min.X) * 12 * ppi / (scale * 12)  # feet to inch
	
	if image_width <= 15000:
		bottom = boundingBox.Min.Z
		top = boundingBox.Max.Z
		height = bottom
		digit = len(str(int((top - bottom) / voxel_size))) 	
		
		sectionView = create_view(doc, viewFamilyTypeId, boundingBox, voxel_size)
		apply_viewTemplate(doc, sectionView, viewTemplateName)
		
		while height < top:
			if count > 2:  # TEMP for test
				break
		
			heights.append(height)
		
			height += voxel_size	
			update_view(doc, sectionView, voxel_size)
			
			imageName = filePath + "\\" + str(count).rjust(digit)
			export_view_image(sectionView, imageName, image_width, doc)
			
			count += 1
			
		if is_delete:
			delete_views(doc, [sectionView])
			
		TransactionManager.Instance.ForceCloseTransaction()  # Dynamo transaction force close order
			
		OUT = "succeed", sectionView, image_width, boundingBox.Min, boundingBox.Max, heights
	else:
		OUT = "failed: image_width out of range > 15000, please set ppi smaller", image_width
except Exception as e:
	OUT =  "failed", e
# ----------------------------------------
